# Grasshopper definition Studio I_Sauna V3.gh (Grasshopper 0.9.75)

dom = ConstructDomain(DomainStart=Slider(1, range=0..2), DomainEnd=Slider(1.4, range=0..5))
range = Range(Domain=dom, Steps=10)
graph = GraphMapper(
    range,
    x0=0,
    x1=1,
    y0=0,
    y1=1,
    A=1,
    B=0,
    container_name="Linear",
    Graph_x0=0.25,
    Graph_x1=0.75,
    Graph_y0=0.25,
    Graph_y1=0.75)
ma = MassAddition(Input=graph)  # -> Result, PartialResults
panel = Panel(graph)
total = Slider(10, range=0..20)
dist_bwtn = Slider(0.5, range=0..5)
dist_bwtn_2 = Slider(1, range=0..5)
start = Slider(0.25, range=0..5)
total_2 = Slider(2, range=0..20)
total_3 = Slider(2, range=0..20)
start_2 = Slider(0, range=-1..5)
start_3 = Slider(0.5, range=0..5)
dist_bwtn_3 = Slider(1, range=0..5)
total_4 = Slider(10, range=0..20)
start_4 = Slider(0.5, range=0..5)
dist_bwtn_4 = Slider(0.5, range=0..5)
panel_2 = Panel(ma.PartialResults)
series = Series(Start=start_2, Step=ma.PartialResults, Count=total_2)
series_2 = Series(Start=start, Step=dist_bwtn, Count=total)
series_3 = Series(Start=start_3, Step=panel_2, Count=total_3)
series_4 = Series(Start=start_4, Step=dist_bwtn_4, Count=total_4)
crossref = CrossReference(ListA=series, ListB=series_2, CrossMode=1)  # -> ListA, ListB
crossref_2 = CrossReference(ListListA=series_3, ListListB=series_4, CrossMode=1)  # -> ListListA, ListListB
dom_2 = ConstructDomain(DomainStart=Slider(0.125, range=0..2), DomainEnd=Slider(0.4, range=0..5))
total_5 = Slider(0.125, range=0..20)
dom_3 = ConstructDomain(DomainStart=Slider(0.125, range=0..2), DomainEnd=Slider(0.4, range=0..5))
total_6 = Slider(0.25, range=0..20)
total_7 = Slider(0.5, range=0..20)
total_8 = Slider(0.25, range=0..20)
total_9 = Slider(0.125, range=0..20)
total_10 = Slider(0.5, range=0..20)
range_2 = Range(Domain=dom_2, Steps=10)
pt = ConstructPoint(XCoordinate=crossref_2.ListListA, YCoordinate=0, ZCoordinate=crossref_2.ListListB)
range_3 = Range(Domain=dom_3, Steps=10)
pt_2 = ConstructPoint(XCoordinate=crossref.ListA, YCoordinate=0, ZCoordinate=crossref.ListB)
graph_2 = GraphMapper(
    reverse(range_2),
    x0=0,
    x1=1,
    y0=0,
    y1=1,
    A=1,
    B=0,
    container_name="Linear",
    Graph_x0=0.25,
    Graph_x1=0.75,
    Graph_y0=0.25,
    Graph_y1=0.75)
graph_3 = GraphMapper(
    reverse(range_3),
    x0=0,
    x1=1,
    y0=0,
    y1=1,
    A=1,
    B=0,
    container_name="Linear",
    Graph_x0=0.25,
    Graph_x1=0.75,
    Graph_y0=0.25,
    Graph_y1=0.75)
box = CenterBox(Base=pt, X=total_7, Y=total_8, Z=total_9)
box_2 = CenterBox(Base=pt_2, X=total_10, Y=total_6, Z=total_5)
